# Dynamo graph raised-access-flooring-generator .dyn "raised-access-flooring-generator" (Dynamo 2.3.0.5885)

# group: <PROJECT NO.> <PROJECT NAME>
# note: CREATED BY: SUMMON IDEA
# CREATED: 20201113
# VERSION <0.1>
# LAST EDITED: <20201117>
# DYNAMO VERSION: <Dynamo 2.3>
# PACKAGES:
# <PACKAGES>
# NOTES:
# <NOTES>
# DYNAMO GRAPHIC STANDARD
# CREATED BY: SUMMON IDEA
# WHITE ARKITEKTER AB - 2016

# group: DESIGNER'S GUIDELINES
# note: DESIGNER'S GUIDELINES
# 1. DIVIDE THE DYNAMO DEFINITION INTO THE USER INTERFACE AND THE BACK-END
# 2. BUILD THE DEFINITION WITH SMALL BLOCKS
# 3. BLOCKS SHOULD ALWAYS HAVE INPUT/OUTPUT
# 4. RENAME INPUT/OUTPUT CONTAINERS TO DATA THEY CARRY
# 5. COLOR-CODE BLOCKS ACCORDING TO THE TEMPLATE

# group: DESIGN
# note: DESIGN
# note: USE:
# FOR THE BACK-END FUNCTIONALITY

# group: USER INTERFACE
# note: INPUT + CONTROL

# group: DESIGN
# note: BACK-END FUNCTIONALITY

# group: CONTROL
# note: CONTROL
# note: USE:
# FOR THE USER INPUT (SUCH AS SLIDERS,
#  NUMBERS, ....)

# group: INPUT
# note: INPUT
# note: USE:
# FOR THE INCOMMING REFFERENCES
# (FILE PATHS, GEOMETRIES ...                     )

# group: TO REVIT
# note: TO REVIT
# note: USE:
# FOR BLOCKS THAT EXPORT THE GEOMETRY AND PARAMETERS TO REVIT

# group: MONITOR
# note: MONITOR
# note: USE:
# FOR IMPORTANT WATCH NODES

# group: ANNOTATION
# note: ANNOTATION
# note: USE:
# FOR COMMENTS

# group: WIP
# note: WIP
# note: USE:
# FOR "WORK IN PROGRESS"

# group: POLYGON VERTICES
number_slider = DoubleSlider(0, range=-100..100 step 1)
number_slider_2 = DoubleSlider(0, range=-100..100 step 1)
number_slider_3 = DoubleSlider(0, range=-100..100 step 1)
number_slider_4 = DoubleSlider(30, range=-100..100 step 1)
number_slider_5 = DoubleSlider(-5, range=-100..100 step 1)
number_slider_6 = DoubleSlider(0, range=-100..100 step 1)
number_slider_7 = DoubleSlider(21.952, range=-100..100 step 1)
number_slider_8 = DoubleSlider(34.556, range=-100..100 step 1)
number_slider_9 = DoubleSlider(0, range=-100..100 step 1)
number_slider_10 = DoubleSlider(6.348, range=-100..100 step 1)
number_slider_11 = DoubleSlider(18.306, range=-100..100 step 1)
number_slider_12 = DoubleSlider(0, range=-100..100 step 1)

# group: POLYGON CREATION
byCoordinates = Point.ByCoordinates(x=number_slider, y=number_slider_2, z=number_slider_3)
byCoordinates_2 = Point.ByCoordinates(x=number_slider_4, y=number_slider_5, z=number_slider_6)
byCoordinates_3 = Point.ByCoordinates(x=number_slider_7, y=number_slider_8, z=number_slider_9)
byCoordinates_4 = Point.ByCoordinates(x=number_slider_10, y=number_slider_11, z=number_slider_12)
list_create = List.Create(item0=byCoordinates, item1=byCoordinates_2, item2=byCoordinates_3, item3=byCoordinates_4)
byPoints = Polygon.ByPoints(points=list_create)
explode = Geometry.Explode(geometry=byPoints)
startPoint = Curve.StartPoint(curve=explode)
byPatch = Surface.ByPatch(closedCurve=byPoints)

# group: GRID SIZE
grid_width_length = CodeBlock { 2; }

# group: GRID GENERATION
length = Curve.Length(curve=explode)
maximumItem = List.MaximumItem(list=length)
indexOf = List.IndexOf(list=length, element=maximumItem)
code_block = CodeBlock(lines=explode, index=indexOf) { lines[index]; }
startPoint_2 = Curve.StartPoint(curve=code_block)
endPoint = Curve.EndPoint(curve=code_block)
byTwoPoints = Vector.ByTwoPoints(start=startPoint_2, end=endPoint)
ZAxis = Vector.ZAxis()
cross = Vector.Cross(vector=ZAxis, cross=byTwoPoints)
byOriginVectors = CoordinateSystem.ByOriginVectors(origin=startPoint_2, xAxis=byTwoPoints, yAxis=cross, zAxis=ZAxis)
ZAxis_2 = CoordinateSystem.ZAxis(coordinateSystem=byOriginVectors)
byWidthLength = Rectangle.ByWidthLength(cs=byOriginVectors, width=grid_width_length, length=grid_width_length)
XAxis = CoordinateSystem.XAxis(coordinateSystem=byOriginVectors)
code_block_2 = CodeBlock { -1; }
translate = Geometry.Translate(geometry=byWidthLength, direction=XAxis, distance=code_block_2)
YAxis = CoordinateSystem.YAxis(coordinateSystem=byOriginVectors)
translate_2 = Geometry.Translate(geometry=translate, direction=YAxis, distance=code_block_2)
X = Point.X(point=startPoint)
minimumItem = List.MinimumItem(list=X)
maximumItem_2 = List.MaximumItem(list=X)
code_block_3 = CodeBlock(sx=minimumItem, ex=maximumItem_2) { sx*2..ex*2..2; }
translate_3 = Geometry.Translate(geometry=translate_2, direction=XAxis, distance=code_block_3)
Y = Point.Y(point=startPoint)
minimumItem_2 = List.MinimumItem(list=Y)
maximumItem_3 = List.MaximumItem(list=Y)
code_block_4 = CodeBlock(sy=minimumItem_2, ey=maximumItem_3) { sy*2..ey*2..2; }
translate_4 = Geometry.Translate(geometry=translate_3, direction=YAxis, distance=code_block_4, lacing=CrossProduct)
byPatch_2 = Surface.ByPatch(closedCurve=translate_4)
flatten = List.Flatten(list=byPatch_2)

# group: PANEL FINDING AND INTERSECTION
doesIntersect = Geometry.DoesIntersect(geometry=byPatch, other=flatten)
filterByBoolMask = List.FilterByBoolMask(list=flatten, mask=doesIntersect)
watch = Watch(filterByBoolMask.in)
code_block_5 = CodeBlock { 255; 100; }
byARGB = Color.ByARGB(a=code_block_5.out1, r=code_block_5.out0, g=code_block_5.out0)
byGeometryColor = Modifiers.GeometryColor.ByGeometryColor(geometry=filterByBoolMask.in, color=byARGB)
intersect = Geometry.Intersect(geometry=byPatch, other=filterByBoolMask.in)
flatten_2 = List.Flatten(list=intersect)
type = Object.Type(obj=flatten_2)
string = StringInput("surface")
boolean = BoolSelector(true)
contains = String.Contains(str=type, searchFor=string, ignoreCase=boolean)
filterByBoolMask_2 = List.FilterByBoolMask(list=flatten_2, mask=contains)
perimeterCurves = Surface.PerimeterCurves(surface=filterByBoolMask_2.in)

startPoint_3 = Curve.StartPoint(curve=perimeterCurves)
X_2 = Point.X(point=startPoint_3)
Y_2 = Point.Y(point=startPoint_3)
flatten_3 = List.Flatten(list=startPoint_3)
code_block_6 = CodeBlock { 0.1; }
pruneDuplicates = Point.PruneDuplicates(points=flatten_3, tolerance=code_block_6)
ZAxis_3 = Vector.ZAxis()
code_block_7 = CodeBlock { -1; }
translate_5 = Geometry.Translate(geometry=pruneDuplicates, direction=ZAxis_3, distance=code_block_7)
byStartPointEndPoint = Line.ByStartPointEndPoint(startPoint=translate_5, endPoint=pruneDuplicates)

# group: PEDESTAL FAMILY INPUT
levels = Levels("Level 1")
structural_column_types = StructuralColumnTypes("W10X33")

# group: PEDESTAL TO REVIT
columnByCurve = StructuralFraming.ColumnByCurve(curve=byStartPointEndPoint, level=levels, structuralColumnType=structural_column_types)

byJoinedCurves = PolyCurve.ByJoinedCurves(curves=perimeterCurves)

# group: PANEL OFFSET TO GRID
panel_offset_to_grid = CodeBlock { -0.05; }

offset = Curve.Offset(curve=byJoinedCurves, distance=panel_offset_to_grid)
clean = List.Clean(list=offset)
explode_2 = Geometry.Explode(geometry=clean)
byJoinedCurves_2 = PolyCurve.ByJoinedCurves(curves=explode_2)

# group: PANEL FAMILY INPUT
floor_types = FloorTypes("3\" LW Concrete on 2\" Metal Deck")

# group: PANEL TO REVIT
byOutlineTypeAndLevel = Floor.ByOutlineTypeAndLevel(outline=byJoinedCurves_2, floorType=floor_types, level=levels)
byOutlineTypeAndLevel_2 = Floor.ByOutlineTypeAndLevel(outlineCurves=clean, level=levels)  # frozen; unwired: floorType
